vi "802.11 Host.gvi"   [LabVIEW Communications System Design Suite 2.0.1]
panel controls:
  "Trigger TX": bool
  "Clear events": bool
  "Operation Mode": T2 = "RF Loopback"
  "Primary Subband": UFXP(2.0) = 1
  "Transmit IP Address": string = "127.0.0.1"
  "Receive Port": u16 = 12345
  "Tab": i32
  "Power Level [dBm]": f64
  "TX Frequency [Hz]": f64 = 2437000000
  "Destination MAC Address": u8[6] = [71, 111, 75, 117, 109, 98]
  "Device MAC Address": u8[6] = [71, 111, 75, 117, 109, 97]
  "TX Port (USRP only)": enum{"TX1/RF 0", "TX1/RF 1"} = "TX1/RF 0"
  "RX Port (USRP only)": T3 = "RX2/RF 1"
  "AGC": bool = TRUE
  "Manual RX gain [dB]": f64 = 37.5
  "PN Data Packet Size": i32 = 1024
  "Subcarrier Format": i32 = "20 MHz (IEEE 802.11 a)"(0)
  "Stop": bool
  "RIO Device": string = "RIO0"
  "Station": bool
  "reset TX staistics": bool
  "reset RX staistics": bool
  "PN Packets per Second": u32 = 1000
  "Transmit ACK": bool = TRUE
  "Backoff": u16 = 4
  "All": bool
  "None": bool
  "Events to Track": T5
  "CCA Energy Detection Threshold [dBm]": FXP(10.3) = -72
  "MCS": UFXP(4.0) = 4
  "session": "802.11 Host Session.gtype"
  "Data Source Option": i32 = 1
  "Data Sink Options": i32
  "Data Source": T11 = "PN Data"
  "Data Sink": enum{"Off", "UDP"} = "Off"
  "Reference Clock": string = "Internal"
  "USRP bandwidth": "USRP bandwidth.gtype" = "40 MHz"
  "UDP 0 Port": u16 = 1111
  "UDP 1 Port": u16 = 2222
  "UDP 2 Port": u16 = 3333
  "UDP 3 Port": u16 = 4444
  "UDP 4 Port": u16 = 5555
  "Manual Selection": u8
  "Sink Ports": u16[5]
  "UDP Sink Port Selection": string
  "Mamual?": bool
  "Number of Streams": u8
  "Scheduling Algorithm": enum{"Round Robin", "HDR-VBR"} = "Round Robin"
panel indicators:
  "Events": string
  "MAC TX Statistic": T1
  "Baseband Power": f64
  "Coerced LO frequency TX [Hz]": f64
  "Coerced LO frequency RX [Hz]": f64
  "Channel Estimation": cluster{"Element 1": i32[], "Element 2": f64[]}[]
  "TX Block Error Rate": f64
  "Coerced Power Level [dBm]": f64
  "RX Throughput": f64
  "Applied RX Gain [dB]": f64
  "RX Throughput [bits/s]": f64
  "Current TX Block Error Rate (BLER)": f64
  "RX Frequency [Hz]": f64
  "Overwritten by Device MAC Address": bool
  "Station Active": bool
  "Device Ready": bool
  "Baseband RX Power [dBFS]": f64
  "RX Constellation": c128[]
  "RX Power Spectrum": T4
  "TX Power Spectrum": T4
  "Data Transfer": bool
  "FIFO Full": bool
  "FIFO Full": bool
  "Data Transfer": bool
  "Compensated CFO [Hz]": f64
  "TX Data Dropped": bool
  "modulation and coding rate": string
  "MAC RX Statistic": T10
  "Target FIFO Overflow": bool
  "RF Input Power": f64[][]
  "0 Data": bool
  "1 Data": bool
  "2 Data": bool
  "3 Data": bool
  "4 Data": bool
  "Scheduled ID": u8
  "Ready for Scheduling": bool
types:
  T1 = cluster{"TX after SIFS Requests Detected": u32, "TX after SIFS Requests Completed": u32, "TX after Backoff Requests Detected": u32, "TX after Backoff Requests Completed": u32}
  T2 = enum{"Baseband Loopback", "RF Loopback", "RF Multi Station"}
  T3 = enum{"RX1/RF 0", "RX2/RF 0", "RX1/RF 1", "RX2/RF 1"}
  T4 = cluster{"f0": f64, "df": f64, "magnitude": f64[]}
  T5 = cluster{"PhyTxStart": bool, "PhyTxEnd": bool, "PhyRxStart": bool, "PhyRxEnd": bool, "MacChannelState": bool, "MacTxStatus": bool, "PhyCcaTiming": bool, "PhyCcaTiming_2": bool, "PhyCcaTiming_3": bool}
  T6 = cluster{"Timestamp": u32, "Transferred Bytes": u32}
  T7 = cluster{"fpga ref": any, "bus instance": u32, "instruction FIFO depth": u32, "executing on FPGA target": bool, "show error call chain": bool}
  T8 = cluster{"Actual Gain [dB]": f64, "Attenuation Table Index": i32}
  T9 = cluster{"Attenuation Table [dB]": f64[][], "Frequencies [Hz]": f64[], "IQ Imbalance Table": "niUsrpRio Config v1 Host.lvlib__IQ Imbalance.gtype"[], "Gain Table": T8[][]}
  "niInstr Register Bus v0 Host.lvlib__Register Bus Session.gtype" = Queue<"niInstr Register Bus v0 Host.lvlib__Session Data.gtype">
  "Semaphore RefNum.gtype" = i32
  "niUsrpRio Config v1 Host.lvlib__DB Queue Reference.gtype" = Queue<"niUsrpRio Config v1 Host.lvlib__Daughterboard Data.gtype">
  "niUsrpRio Config v1 Host.lvlib__niUsrpRio Session.gtype" = cluster{"FPGA Interface": any, "RIO Interface Number": u32, "Data Clock Rate": u32, "FPGA Data Clock Rate": u32, "Global Settings Register Bus": "niInstr Register Bus v0 Host.lvlib__Register Bus Session.gtype", "Radio 0 Settings Register Bus": "niInstr Register Bus v0 Host.lvlib__Register Bus Session.gtype", "Radio 1 Settings Register Bus": "niInstr Register Bus v0 Host.lvlib__Register Bus Session.gtype", "Radio Settings Bus Semaphore": "Semaphore RefNum.gtype", "DB Queues": "niUsrpRio Config v1 Host.lvlib__DB Queue Reference.gtype"[], "Characterization Data Valid?": bool, "EEPROM Header": "niUsrpRio Config v1 Host.lvlib__EEPROM Header.gtype", "Device Data Header": "niUsrpRio Config v1 Host.lvlib__EEPROM Device Data Header.gtype", "EEPROM Characterization Header": "niUsrpRio Config v1 Host.lvlib__EEPROM Characterization Header.gtype", "Characterization Data": "niUsrpRio Config v1 Host.lvlib__Characterization Data.gtype"[], "FPGA Current Version": u32, "FPGA Oldest Compatible Version": u32, "Fixed Logic Current Version": u32, "Fixed Logic Oldest Compatible Version": u32, "FPGA Radio Settings Bus Current Version": u32, "FPGA Radio Settings Bus Oldest Compatible Version": u32, "FPGA Board Config Current Version": u32, "FPGA Board Config Oldest Compatible Version": u32, "Daughterboard Clock Rate": u32}
  "802.11 Host Session.gtype" = cluster{"FPGA interface": "802.11 FGPA Reference.gtype", "send queue": Queue<u8[]>, "receive queue": Queue<u8[]>, "receive throughput queue": Queue<T6>, "UDP Receiver": UdpNetworkConnectionRefnum, "PN packet": u8[], "FlexRIO session": Queue<T7>, "FlexRIO TX Characterization Data": T9, "FlexRIO RX Characterization Data": T9, "USRP session": "niUsrpRio Config v1 Host.lvlib__niUsrpRio Session.gtype", "RF loop clock frequency": f64, "send queue_2": Queue<u8[]>, "send queue_3": Queue<u8[]>, "send queue_4": Queue<u8[]>, "send queue_5": Queue<u8[]>, "UDP Receiver_2": UdpNetworkConnectionRefnum, "UDP Receiver_3": UdpNetworkConnectionRefnum, "UDP Receiver_4": UdpNetworkConnectionRefnum, "UDP Receiver_5": UdpNetworkConnectionRefnum, "receive queue_2": Queue<u8[]>, "receive queue_3": Queue<u8[]>, "receive queue_4": Queue<u8[]>, "receive queue_5": Queue<u8[]>}
  T10 = cluster{"Packet Starts detected": u32, "Frames from PHY": u32, "Frames with FCS pass": u32, "ACKs Received": u32}
  T11 = enum{"UDP", "PN Data", "Manual", "UDP with 5 sources"}
  "USRP bandwidth.gtype" = enum{"40 MHz", "120 MHz", "160 MHz"}
  T12 = cluster{"TX after SIFS requests detected": u32, "TX after SIFS requests completed": u32, "TX after backoff requests detected": u32, "TX after backoff requests completed": u32}
  T13 = cluster{"Frames detected": u32, "Subframes received": u32, "Valid subframes received": u32, "ACKs received": u32}
  T14 = cluster{"PhyTxStart": bool, "PhyTxEnd": bool, "PhyRxStart": bool, "PhyRxEnd": bool, "MacChannelState": bool, "MacTxStatus": bool, "PhyCcaTiming": bool, "PhyRxGainChange": bool, "PhyRxAGCStateChange": bool}
  T15 = cluster{"remove header": bool, "block unsupported frame types": bool, "block FCS errors": bool, "block address mismatch": bool, "block header recognize error": bool}
diagram:
  sequence {
    frame 0 {
      $Events <- EmptyString
      $"Device Ready" <- FALSE
      $"Station Active" <- FALSE
      $Station <- FALSE
      $"RX Constellation" <- c128[] []
      $"RX Power Spectrum" <- T4 {all zero or empty}
      $"TX Power Spectrum" <- T4 {all zero or empty}
      $"Channel Estimation" <- cluster{"Element 1": i32[], "Element 2": f64[]}[] []
      $"MAC TX Statistic" <- T12 {all zero or empty}
      $"MAC RX Statistic" <- T13 {all zero or empty}
      $"Current TX Block Error Rate (BLER)" <- 0
      $"RX Throughput [bits/s]" <- 0
      $"Compensated CFO [Hz]" <- 0
      for (N = 51) {
        $"RX Throughput" <- NaN
        $"TX Block Error Rate" <- NaN
        $"Baseband Power" <- NaN
      }
      Initialize Array(element=NaN, size=51, size=2) -> w1
      $"RF Input Power" <- w1
    }
  }
  call "Create Stop Notifier.gvi"(error in=no error) -> (error out=w2)
  call "802.11 Host Init.gvi"(device=$"RIO Device", error in=w2, reference clock=$"Reference Clock", USRP bandwidth=$"USRP bandwidth") -> (session out=w3, error out=w4)
  case (w4) {
    frame Error {
      w5 = w4
    }
    frame No Error {
      $"Device Ready" <- TRUE
      $session <- w3
      w5 = w4
    }
  }
  s1 = w5  # shift register
  s2 = string[] []  # shift register
  while {
    call "802.11 Unbundle Session.gvi"(session=$session) -> (FPGA interface=w6)
    call "802.11 Prepare Constellation.gvi"(FPGA interface=w6, error in=s1, maximal number of subcarriers=4800) -> (error out=w7, data field constellation=w8, update constellation=w9)
    # update plots and indicators (slow)
    Logical And($"Station Active", w9) -> w10
    case (w10) {
      frame False { }
      frame True {
        $"RX Constellation" <- w8
      }
    }
    call "802.11 Read Event FIFO.gvi"(FPGA interface=w6, error in=s1) -> (raw events=w11, error out=w12)
    call "802.11 Prepare RX Power Spectrum.gvi"(FPGA interface=w6, error in=s1) -> (error out=w13, RX power spectrum=w14, update power spectrum=w15)
    call "802.11 Prepare TX Power Spectrum.gvi"(FPGA interface=w6, error in=s1) -> (error out=w16, TX power spectrum=w17, update power spectrum=w18)
    call "802.11 Prepare Channel Estimation.gvi"(FPGA interface=w6, error in=s1, channel subband=$"Primary Subband", subcarrier format=$"Subcarrier Format") -> (error out=w19, channel estimation=w20, update power spectrum=w21)
    call "802.11 Read Target Registers.gvi"(FPGA interface=w6, error in=s1) -> (error out=w22, target FIFO overflow=w23, compensated CFO=w24, RF input power=w25, MAC RX statistics=w26, MAC TX statistics=w27, signal power at packet start=w28)
    Merge Errors(w7, w13, w16, w19, w22, w12) -> (error out=w29)
    call "Check Stop.gvi"(error in=w29) -> (error out=w30, stop=w31)
    Logical And($"Station Active", w15) -> w32
    case (w32) {
      frame False, Default { }
      frame True {
        $"RX Power Spectrum" <- w14
      }
    }
    Logical And($"Station Active", w18) -> w33
    case (w33) {
      frame False, Default { }
      frame True {
        $"TX Power Spectrum" <- w17
      }
    }
    Logical And($"Station Active", w21) -> w34
    case (w34) {
      frame False, Default { }
      frame True {
        $"Channel Estimation" <- w20
      }
    }
    $"Target FIFO Overflow" <- w23
    $"Compensated CFO [Hz]" <- w24
    $"RF Input Power" <- w25
    $"Baseband Power" <- w28
    $"MAC RX Statistic" <- w26
    $"MAC TX Statistic" <- w27
    call "802.11 Events to String.gvi"(event data=w11, events to track=$"Events to Track") -> (event strings=w35)
    for {
      w36 = each element of w35
      Match Pattern(regular expression="PhyRxStart.ind ", string=w36) -> (offset past match=w38)
      Is Not Equal(x=w38, y=-1) -> w39
      append w39 to w37
    }
    Or Array Elements(Boolean array=w37)
    w40 = -12  # CFX data type offset
    Add(w28, w40) -> w41
    $"Baseband RX Power [dBFS]" <- w41
    Build Array[ConcatenateInputs=True](s2, w35) -> w42
    Delete From Array(inArray=w42, length (1)=10000) -> (deleted=w43)
    Select(s=$"Clear events", t=string[] [], f=w43) -> w44
    Concatenate Strings(w43) -> w45
    $Events <- w45
    Select(s=$None, t=T14 {all zero or empty}, f=$"Events to Track") -> w46
    w47 = T14 {"PhyTxStart"=TRUE, "PhyTxEnd"=TRUE, "PhyRxStart"=TRUE, "PhyRxEnd"=TRUE, "MacChannelState"=TRUE, "MacTxStatus"=TRUE, "PhyCcaTiming"=TRUE, "PhyRxGainChange"=TRUE, "PhyRxAGCStateChange"=TRUE}
    Select(s=$All, t=w47, f=w46) -> w48
    $"Events to Track" <- w48
    Wait Until Next Multiple(multiple to wait=250)
    next s1 = w30
    next s2 = w44
    stop if w31
  }
  call "Stop On Error.gvi"(error in=s1) -> (error out=w49)
  s3 = w5  # shift register
  while {
    Feedback Node(input=$"Station Active") -> w50
    Is Not Equal(x=$"Station Active", y=w50) -> w51
    # update plots and indicators (fast)
    case ($"Station Active") {
      frame False, Default {
        w52 = s3
      }
      frame True {
        call "802.11 Unbundle Session.gvi"(session=$session) -> (FPGA interface=w53, receive throughput queue=w54)
        call "802.11 Prepare Throughput Measurements.gvi"(reset=w51, FPGA interface=w53, receive throughput queue=w54, error in=s3, timing granularity=100) -> (error out=w52, TX block error rate=w55, RX throughput=w56)
        $"Current TX Block Error Rate (BLER)" <- w55
        $"TX Block Error Rate" <- w55
        $"RX Throughput [bits/s]" <- w56
        Divide(x=w56, y=1000000) -> w57
        $"RX Throughput" <- w57
      }
    }
    call "Check Stop.gvi"(error in=w52) -> (error out=w58, stop=w59)
    Wait Until Next Multiple(multiple to wait=100)
    next s3 = w58
    stop if w59
  }
  call "Stop On Error.gvi"(error in=s3) -> (error out=w60)
  s4 = w5  # shift register
  while {
    Property Node(instance in=$session) -> ("FPGA interface"=w61, "receive throughput queue"=w62, "receive queue"=w63, "receive queue_2"=w64, "receive queue_3"=w65, "receive queue_4"=w66, "receive queue_5"=w67)
    # RX Reception
    case ($"UDP Sink Port Selection") {
      frame "A", Default {
        call "802.11 Receive RX ICP.gvi"(FPGA interface=w61, error in=s4, receive queue=w63, receive throughput queue=w62, enqueue decoded data=$"Station Active") -> (error out=w68)
      }
      frame "B" {
        call "802.11 Receive RX ICP.gvi"(FPGA interface=w61, error in=s4, receive queue=w64, receive throughput queue=w62, enqueue decoded data=$"Station Active") -> (error out=w68)
      }
      frame "C" {
        call "802.11 Receive RX ICP.gvi"(FPGA interface=w61, error in=s4, receive queue=w65, receive throughput queue=w62, enqueue decoded data=$"Station Active") -> (error out=w68)
      }
      frame "D" {
        call "802.11 Receive RX ICP.gvi"(FPGA interface=w61, error in=s4, receive queue=w66, receive throughput queue=w62, enqueue decoded data=$"Station Active") -> (error out=w68)
      }
      frame "E" {
        call "802.11 Receive RX ICP.gvi"(FPGA interface=w61, error in=s4, receive queue=w67, receive throughput queue=w62, enqueue decoded data=$"Station Active") -> (error out=w68)
      }
    }
    call "Check Stop.gvi"(error in=w68) -> (error out=w69, stop=w70)
    Wait Until Next Multiple(multiple to wait=0)
    next s4 = w69
    stop if w70
  }
  call "Stop On Error.gvi"(error in=s4) -> (error out=w71)
  w72 = $"Data Source"
  s5 = w5  # shift register
  while {
    # configuration
    call "802.11 Unbundle Session.gvi"(session=$session) -> (FPGA interface=w73)
    Feedback Node(input=$"Station Active") -> w74
    case ($"Station Active") {
      frame False, Default {
        w75 = s5
      }
      frame True {
        Is Not Equal(x=$"Station Active", y=w74) -> w76
        call "802.11 Gain Control.gvi"(initialize=w76, RX Port (USRP only)=$"RX Port (USRP only)", session=$session, AGC=$AGC, error in=s5, Manual RX gain [dB]=$"Manual RX gain [dB]", RX Frequency [Hz]=$"RX Frequency [Hz]", TX Port (USRP only)=$"TX Port (USRP only)") -> (Applied RX Gain [dB]=w77, error out=w78)
        $"Applied RX Gain [dB]" <- w77
        call "802.11 Subcarrier Format to Configuration.gvi"(MCS=$MCS, subcarrier format=$"Subcarrier Format", error in=s5) -> (error out=w79, format=w80)
        call "802.11 Configure Dynamic Parameters.gvi"(FPGA interface=w73, error in=w79, format=w80, transmit ACK=$"Transmit ACK", backoff value=$Backoff, CCA energy detection threshold=$"CCA Energy Detection Threshold [dBm]") -> (error out=w81)
        Merge Errors(w78, w81) -> (error out=w75)
      }
    }
    w82 = $Station
    Feedback Node(input=w82) -> w83
    Logical Exclusive Or(w82, w83) -> w84
    case (w84) {
      frame False, Default {
        w85 = s5
      }
      frame True {
        case (w82) {
          frame False, Default {
            sequence {
              frame 0 {
                $"Station Active" <- w82
              }
            }
            call "802.11 Unbundle Session.gvi"(session=$session) -> (UDP receiver=w86)
            Udp Close(connection ID=w86, error in=s5) -> (error out=w87)
            call "Clear Errors.gvi"(specific error code to clear=1, error in=w87) -> (error out=w88)
            call "802.11 Abort RF Streams.gvi"(session=$session, error in=w88) -> (error out=w85)
          }
          frame True {
            $"RX Frequency [Hz]" <- $"TX Frequency [Hz]"
            call "802.11 FPGA Target Configuration.gvi"() -> (maximum gain=w89, enable DC offset correction=w90)
            w91 = T15 {"remove header"=TRUE, "block unsupported frame types"=TRUE, "block FCS errors"=TRUE, "block address mismatch"=TRUE, "block header recognize error"=TRUE}
            call "802.11 Configure Static Parameters.gvi"(session in=$session, error in=s5, primary subband=$"Primary Subband", operation mode=$"Operation Mode", enable DC offset correction=w90, MPDU filter configuration=w91, device MAC address=$"Device MAC Address") -> (session dup=w92, error out=w93)
            call "802.11 Reset Statistics.gvi"(session in=w92, error in=w93, reset RX statistics=TRUE, reset TX statistics=TRUE) -> (error out=w94, session dup=w95)
            call "802.11 Configure TX RF.gvi"(TX port=$"TX Port (USRP only)", session=w95, TX frequency=$"TX Frequency [Hz]", TX power level=$"Power Level [dBm]", error in=w94) -> (session dup=w96, error out=w97, coerced TX power level=w98, coerced LO frequency=w99)
            call "802.11 Configure RX RF.gvi"(RX frequency=$"TX Frequency [Hz]", session=w96, RX gain=w89, error in=w97, RX port=$"RX Port (USRP only)") -> (error out=w100, session dup=w101, coerced RX gain=w102, coerced LO frequency=w103)
            call "802.11 Configure AGC Registers.gvi"(TX Port=$"TX Port (USRP only)", enable AGC=FALSE, session=w101, RX port=$"RX Port (USRP only)", error in=w100) -> (error out=w104, session dup=w105)
            call "802.11 Set Power Calibration Offset.gvi"(session=w105, frequency=$"TX Frequency [Hz]", error in=w104, RX port=$"RX Port (USRP only)") -> (session dup=w106, error out=w107)
            call "802.11 Configure RF Streams.gvi"(TX port=$"TX Port (USRP only)", RX port=$"RX Port (USRP only)", session=w106, error in=w107) -> (session dup=w108, error out=w109)
            case (w72) {
              frame "UDP" {
                call "802.11 Configure Data Source.gvi"(error in=w109, receive port=$"Receive Port", session in=w108) -> (error out=w85, session out=w110, success?=w111)
              }
              frame "PN Data" {
                call "802.11 Configure Data Source.gvi"(error in=w109, receive port=$"Receive Port", session in=w108) -> (error out=w85, session out=w110, success?=w111)
              }
              frame "Manual", Default {
                call "802.11 Configure Data Source.gvi"(error in=w109, receive port=$"Receive Port", session in=w108) -> (error out=w85, session out=w110, success?=w111)
              }
              frame "UDP with 5 sources" {
                call "CONFIGURE DATA SOURCE VICTOR.gvi"(receive port=$"UDP 0 Port", session in=w108, error in=w109, receive port_2=$"UDP 1 Port", receive port_3=$"UDP 2 Port", receive port_4=$"UDP 3 Port", receive port_5=$"UDP 4 Port") -> (session out=w110, success?=w111, error out=w85)
              }
            }
            $session <- w110
            sequence {
              frame 0 {
                $Station <- w111
                $"Station Active" <- w82
              }
            }
            $"Coerced LO frequency RX [Hz]" <- w103
            $"Applied RX Gain [dB]" <- w102
            $"Coerced LO frequency TX [Hz]" <- w99
            $"Coerced Power Level [dBm]" <- w98
          }
        }
      }
    }
    call "802.11 Reset Statistics.gvi"(session in=$session, error in=s5, reset RX statistics=$"reset RX staistics", reset TX statistics=$"reset TX staistics") -> (error out=w112)
    call "802.11 Subcarrier Format to Configuration.gvi"(MCS=$MCS, subcarrier format=$"Subcarrier Format", error in=w112) -> (modulation and coding rate=w113, error out=w114)
    Merge Errors(w75, w85, w114) -> (error out=w115)
    call "Create Stop.gvi"(error in=w115, stop in=$Stop) -> (error out=w116)
    call "Check Stop.gvi"(error in=w116) -> (error out=w117, stop=w118)
    Wait Until Next Multiple(multiple to wait=100)
    $"modulation and coding rate" <- w113
    next s5 = w117
    stop if w118
  }
  call "Stop On Error.gvi"(error in=s5) -> (error out=w119)
  s6 = w5  # shift register
  while {
    # TX transmission
    Wait Until Next Multiple(multiple to wait=0)
    w120 = $"Station Active"
    Property Node(instance in=$session) -> ("send queue"=w121, "send queue_2"=w122, "send queue_3"=w123, "send queue_4"=w124, "send queue_5"=w125, "FPGA interface"=w126)
    while {
      Is Not Equal(x=$"Operation Mode", y="RF Multi Station") -> w127
      $"Overwritten by Device MAC Address" <- w127
      Dequeue Element(error in=s6, queue=w121, timeout in ms=0) -> (element=w128, error out=w129, timed out?=w130)
      Select(s=w127, t=$"Device MAC Address", f=$"Destination MAC Address") -> w131
      Build Cluster($MCS, w126, $"Subcarrier Format", $"Device MAC Address", w131) -> w132
      Logical And(w120, not w130) -> w133
      case (w133) {
        frame False {
          w134 = w129
          w135 = FALSE
        }
        frame True {
          Property Node(instance in=w132) -> ("Element 1"=w136, "Element 2"=w137, "Element 3"=w138, "Element 4"=w139, "Element 5"=w140)
          call "802.11 Subcarrier Format to Configuration.gvi"(MCS=w136, subcarrier format=w138, error in=w129) -> (error out=w141, format=w142, bandwidth=w143, valid configuration=w144)
          case (w144) {
            frame False, Default {
              w135 = FALSE
              w134 = w141
            }
            frame True {
              call "Send TX ICP_0.gvi"(format=w142, bandwidth=w143, MCS=w136, device MAC address=w139, destination MAC address=w140, payload=w128, FPGA interface=w137, error in=w141) -> (dropped?=w135, error out=w134)
            }
          }
        }
      }
      Dequeue Element(error in=s6, queue=w122, timeout in ms=0) -> (element=w145, error out=w146, timed out?=w147)
      Logical And(w120, not w147) -> w148
      case (w148) {
        frame False {
          w149 = w146
          w150 = FALSE
        }
        frame True {
          Property Node(instance in=w132) -> ("Element 1"=w151, "Element 2"=w152, "Element 3"=w153, "Element 4"=w154, "Element 5"=w155)
          call "802.11 Subcarrier Format to Configuration.gvi"(MCS=w151, subcarrier format=w153, error in=w146) -> (error out=w156, format=w157, bandwidth=w158, valid configuration=w159)
          case (w159) {
            frame False, Default {
              w150 = FALSE
              w149 = w156
            }
            frame True {
              call "Send TX ICP_1.gvi"(format=w157, bandwidth=w158, MCS=w151, device MAC address=w154, destination MAC address=w155, payload=w145, FPGA interface=w152, error in=w156) -> (dropped?=w150, error out=w149)
            }
          }
        }
      }
      Dequeue Element(error in=s6, queue=w123, timeout in ms=0) -> (element=w160, error out=w161, timed out?=w162)
      Logical And(w120, not w162) -> w163
      case (w163) {
        frame False {
          w164 = w161
          w165 = FALSE
        }
        frame True {
          Property Node(instance in=w132) -> ("Element 1"=w166, "Element 2"=w167, "Element 3"=w168, "Element 4"=w169, "Element 5"=w170)
          call "802.11 Subcarrier Format to Configuration.gvi"(MCS=w166, subcarrier format=w168, error in=w161) -> (error out=w171, format=w172, bandwidth=w173, valid configuration=w174)
          case (w174) {
            frame False, Default {
              w165 = FALSE
              w164 = w171
            }
            frame True {
              call "Send TX ICP_2.gvi"(format=w172, bandwidth=w173, MCS=w166, device MAC address=w169, destination MAC address=w170, payload=w160, FPGA interface=w167, error in=w171) -> (dropped?=w165, error out=w164)
            }
          }
        }
      }
      Dequeue Element(error in=s6, queue=w124, timeout in ms=0) -> (element=w175, error out=w176, timed out?=w177)
      Logical And(w120, not w177) -> w178
      case (w178) {
        frame False {
          w179 = w176
          w180 = FALSE
        }
        frame True {
          Property Node(instance in=w132) -> ("Element 1"=w181, "Element 2"=w182, "Element 3"=w183, "Element 4"=w184, "Element 5"=w185)
          call "802.11 Subcarrier Format to Configuration.gvi"(MCS=w181, subcarrier format=w183, error in=w176) -> (error out=w186, format=w187, bandwidth=w188, valid configuration=w189)
          case (w189) {
            frame False, Default {
              w180 = FALSE
              w179 = w186
            }
            frame True {
              call "Send TX ICP_3.gvi"(format=w187, bandwidth=w188, MCS=w181, device MAC address=w184, destination MAC address=w185, payload=w175, FPGA interface=w182, error in=w186) -> (dropped?=w180, error out=w179)
            }
          }
        }
      }
      Dequeue Element(error in=s6, queue=w125, timeout in ms=0) -> (element=w190, error out=w191, timed out?=w192)
      Logical And(w120, not w192) -> w193
      case (w193) {
        frame False {
          w194 = w191
          w195 = FALSE
        }
        frame True {
          Property Node(instance in=w132) -> ("Element 1"=w196, "Element 2"=w197, "Element 3"=w198, "Element 4"=w199, "Element 5"=w200)
          call "802.11 Subcarrier Format to Configuration.gvi"(MCS=w196, subcarrier format=w198, error in=w191) -> (error out=w201, format=w202, bandwidth=w203, valid configuration=w204)
          case (w204) {
            frame False, Default {
              w195 = FALSE
              w194 = w201
            }
            frame True {
              call "Send TX ICP_4.gvi"(format=w202, bandwidth=w203, MCS=w196, device MAC address=w199, destination MAC address=w200, payload=w190, FPGA interface=w197, error in=w201) -> (dropped?=w195, error out=w194)
            }
          }
        }
      }
      Logical Or(w135, w150, w165, w180, w195) -> w205
      $"TX Data Dropped" <- w205
      Merge Errors(w134, w149, w164, w179, w194) -> (error out=w206)
      call "Check Stop.gvi"(error in=w206) -> (error out=w207, stop=w208)
      Logical Or(w208, w130, w147, w162, w177, w192) -> w209
      stop if w209
    }
    call "Check Stop.gvi"(error in=w207) -> (error out=w210, stop=w211)
    Property Node(instance in=w126, "Force H2T ID"=$"Manual Selection", "Force manual ID"=$"Mamual?", "Number of Streams"=$"Number of Streams", "Scheduling Algorithm"=$"Scheduling Algorithm") -> ("Scheduled ID"=w212, "[D] Ready for Scheduleing"=w213)
    $"Scheduled ID" <- w212
    $"Ready for Scheduling" <- w213
    next s6 = w210
    stop if w211
  }
  call "Stop On Error.gvi"(error in=s6) -> (error out=w214)
  Udp Open(error in=w5, net address=0, port=0, service name="", timeout ms=25000) -> (connection ID=w215, error out=w216)
  call "Set Socket Option.gvi"(connection in=w215, level=0xFFFF, option name=0x1001, value=1024000, error in=w216) -> (error out=w217, connection out=w218)
  Udp Open(error in=w5, net address=0, port=0, service name="", timeout ms=25000) -> (connection ID=w219, error out=w220)
  call "Set Socket Option.gvi"(connection in=w219, level=0xFFFF, option name=0x1001, value=1024000, error in=w220) -> (error out=w221, connection out=w222)
  Udp Open(error in=w5, net address=0, port=0, service name="", timeout ms=25000) -> (connection ID=w223, error out=w224)
  call "Set Socket Option.gvi"(connection in=w223, level=0xFFFF, option name=0x1001, value=1024000, error in=w224) -> (error out=w225, connection out=w226)
  Udp Open(error in=w5, net address=0, port=0, service name="", timeout ms=25000) -> (connection ID=w227, error out=w228)
  call "Set Socket Option.gvi"(connection in=w227, level=0xFFFF, option name=0x1001, value=1024000, error in=w228) -> (error out=w229, connection out=w230)
  Udp Open(error in=w5, net address=0, port=0, service name="", timeout ms=25000) -> (connection ID=w231, error out=w232)
  call "Set Socket Option.gvi"(connection in=w231, level=0xFFFF, option name=0x1001, value=1024000, error in=w232) -> (error out=w233, connection out=w234)
  s7 = w217  # shift register
  s8 = w218  # shift register
  while {
    # UDP send and receive
    Wait Until Next Multiple(multiple to wait=0)
    # UDP
    #   v
    # Host queue
    Property Node(instance in=$session) -> ("send queue"=w235, "send queue_2"=w236, "send queue_3"=w237, "send queue_4"=w238, "send queue_5"=w239, "UDP Receiver"=w240, "UDP Receiver_2"=w241, "UDP Receiver_3"=w242, "UDP Receiver_4"=w243, "UDP Receiver_5"=w244, "PN packet"=w245)
    # UDP
    #   ^
    # Host queue
    Property Node(instance in=$session) -> ("receive queue"=w246, "receive queue_2"=w247, "receive queue_3"=w248, "receive queue_4"=w249, "receive queue_5"=w250)
    case ($"Station Active") {
      frame False, Default {
        w251 = s8
        w252 = s7
      }
      frame True {
        Array Subset(array=w245, length0=$"PN Data Packet Size") -> w253
        case (w72) {
          frame "UDP" {
            call "802.11 Receive UDP Data.gvi"(UDP receiver=w240, send queue=w235, error in=s7) -> (data transfer=w255, error out=w254, FIFO full=w256)
            $"FIFO Full" <- w256
          }
          frame "PN Data" {
            call "802.11 Send PN Data.gvi"(PN packets per second=$"PN Packets per Second", send queue=w235, PN data=w253, error in=s7) -> (data transfer=w255, error out=w254)
          }
          frame "Manual", Default {
            # Manual
            case ($"Trigger TX") {
              frame False, Default {
                w254 = s7
                w255 = $"Trigger TX"
              }
              frame True {
                Enqueue Element(element=w253, error in=s7, queue=w235, timeout in ms=-1) -> (error out=w254, queue out=w257)
                w255 = $"Trigger TX"
              }
            }
          }
          frame "UDP with 5 sources" {
            call "802.11 Receive UDP Data.gvi"(UDP receiver=w240, send queue=w235, error in=s7) -> (data transfer=w258, error out=w259)
            call "802.11 Receive UDP Data.gvi"(UDP receiver=w241, send queue=w236, error in=s7) -> (data transfer=w260, error out=w261)
            call "802.11 Receive UDP Data.gvi"(UDP receiver=w242, send queue=w237, error in=s7) -> (data transfer=w262, error out=w263)
            call "802.11 Receive UDP Data.gvi"(UDP receiver=w243, send queue=w238, error in=s7) -> (data transfer=w264, error out=w265)
            call "802.11 Receive UDP Data.gvi"(UDP receiver=w244, send queue=w239, error in=s7) -> (data transfer=w266, error out=w267)
            case ($"Manual Selection") {
              frame 0, Default {
                w254 = w259
                w255 = w258
              }
              frame 1 {
                w254 = w261
                w255 = w260
              }
              frame 2 {
                w254 = w263
                w255 = w262
              }
              frame 3 {
                w254 = w265
                w255 = w264
              }
              frame 4 {
                w254 = w267
                w255 = w266
              }
            }
            $"0 Data" <- w258
            $"1 Data" <- w260
            $"2 Data" <- w262
            $"3 Data" <- w264
            $"4 Data" <- w266
          }
        }
        $"Data Transfer" <- w255
        Is Equal(x=$"Data Sink", y="UDP") -> w268
        call "SEND UDP DATA VICTOR.gvi"(UDP Sink Port Selection=$"UDP Sink Port Selection", Transmit IP Address=$"Transmit IP Address", UDP Sink Ports=$"Sink Ports", Enable=w268, error in=s7, UDP sender=s8, receive queue=w246, receive queue_2=w247, receive queue_3=w248, receive queue_4=w249, receive queue_5=w250, UDP sender_2=w222, UDP sender_3=w226, UDP sender_4=w230, UDP sender_5=w234, error in_2=w221, error in_3=w225, error in_4=w229, error in_5=w233) -> (Error Out=w269, Data Transfer=w270, FIFO Full=w271, UDP sender dup=w251)
        Merge Errors(w254, w269) -> (error out=w252)
        $"Data Transfer" <- w270
        $"FIFO Full" <- w271
      }
    }
    call "Check Stop.gvi"(error in=w252) -> (error out=w272, stop=w273)
    next s7 = w272
    next s8 = w251
    stop if w273
  }
  call "Stop On Error.gvi"(error in=s7) -> (error out=w274)
  Udp Close(connection ID=s8, error in=w274) -> (error out=w275)
  Merge Errors(w119, w214, w71, w275, w49, w60) -> (error out=w276)
  sequence {
    frame 0 {
      w277 = $session
    }
  }
  call "802.11 Host Release.gvi"(session=w277, error in=w276) -> (error out=w278)
  call "Simple Error Handler.gvi"(type of dialog="OK message", error in=w278)
