vi "CONFIGURE DATA SOURCE VICTOR.gvi"   [LabVIEW Communications System Design Suite 2.0.1]
inputs:
  "receive port": u16 = 12345  # Port to use for the UDP socket connection.
  "session in": "802.11 Host Session.gtype"
    # Cluster containing all references the host uses during runtime. This cluster includes the following components:
    # FPGA interface: empty reference to the FPGA handle; needs to be cast each time it is used.
    # FlexRIO session: handle to the FlexRIO device. This component is valid only with FlexRIO devices.
    # FlexRIO TX Characterization Data: This component is valid only with FlexRIO sessions.
    # FlexRIO RX Characterization Data: This component is valid only with FlexRIO sessions.
    # USRP session: handle to the USRP device, including charaterization data. This component is valid only with USRP.
    # stop queue: handle to queue used to coordinate host shutdown between the loops.
    # send queue: handle to queue used to buffer TX packets to the target.
    # receive queue: handle to queue used to buffer RX packets from the target.
    # receive throughput queue: handle to queue used to buffer information about received RX packets (time and transferred bytes).
    # UDP receiver: handle to a UPD socket used to receive payload from outside the host.
    # PN packet: byte array used to stream payload inside the host.
  "error in": error
  "receive port_2": u16 = 12345  # Port to use for the UDP socket connection.
  "receive port_3": u16 = 12345  # Port to use for the UDP socket connection.
  "receive port_4": u16 = 12345  # Port to use for the UDP socket connection.
  "receive port_5": u16 = 12345  # Port to use for the UDP socket connection.
outputs:
  "session out": "802.11 Host Session.gtype"
    # Cluster containing all references the host uses during runtime. This cluster includes the following components:
    # FPGA interface: empty reference to the FPGA handle; needs to be cast each time it is used.
    # FlexRIO session: handle to the FlexRIO device. This component is valid only with FlexRIO devices.
    # FlexRIO TX Characterization Data: This component is valid only with FlexRIO sessions.
    # FlexRIO RX Characterization Data: This component is valid only with FlexRIO sessions.
    # USRP session: handle to the USRP device, including charaterization data. This component is valid only with USRP.
    # stop queue: handle to queue used to coordinate host shutdown between the loops.
    # send queue: handle to queue used to buffer TX packets to the target.
    # receive queue: handle to queue used to buffer RX packets from the target.
    # receive throughput queue: handle to queue used to buffer information about received RX packets (time and transferred bytes).
    # UDP receiver: handle to a UPD socket used to receive payload from outside the host.
    # PN packet: byte array used to stream payload inside the host.
  "success?": bool  # Returns True if configuration succeeded and the system is ready to operate.
  "error out": error
types:
  T1 = cluster{"Timestamp": u32, "Transferred Bytes": u32}
  T2 = cluster{"fpga ref": any, "bus instance": u32, "instruction FIFO depth": u32, "executing on FPGA target": bool, "show error call chain": bool}
  T3 = cluster{"Actual Gain [dB]": f64, "Attenuation Table Index": i32}
  T4 = cluster{"Attenuation Table [dB]": f64[][], "Frequencies [Hz]": f64[], "IQ Imbalance Table": "niUsrpRio Config v1 Host.lvlib__IQ Imbalance.gtype"[], "Gain Table": T3[][]}
  "niInstr Register Bus v0 Host.lvlib__Register Bus Session.gtype" = Queue<"niInstr Register Bus v0 Host.lvlib__Session Data.gtype">
  "Semaphore RefNum.gtype" = i32
  "niUsrpRio Config v1 Host.lvlib__DB Queue Reference.gtype" = Queue<"niUsrpRio Config v1 Host.lvlib__Daughterboard Data.gtype">
  "niUsrpRio Config v1 Host.lvlib__niUsrpRio Session.gtype" = cluster{"FPGA Interface": any, "RIO Interface Number": u32, "Data Clock Rate": u32, "FPGA Data Clock Rate": u32, "Global Settings Register Bus": "niInstr Register Bus v0 Host.lvlib__Register Bus Session.gtype", "Radio 0 Settings Register Bus": "niInstr Register Bus v0 Host.lvlib__Register Bus Session.gtype", "Radio 1 Settings Register Bus": "niInstr Register Bus v0 Host.lvlib__Register Bus Session.gtype", "Radio Settings Bus Semaphore": "Semaphore RefNum.gtype", "DB Queues": "niUsrpRio Config v1 Host.lvlib__DB Queue Reference.gtype"[], "Characterization Data Valid?": bool, "EEPROM Header": "niUsrpRio Config v1 Host.lvlib__EEPROM Header.gtype", "Device Data Header": "niUsrpRio Config v1 Host.lvlib__EEPROM Device Data Header.gtype", "EEPROM Characterization Header": "niUsrpRio Config v1 Host.lvlib__EEPROM Characterization Header.gtype", "Characterization Data": "niUsrpRio Config v1 Host.lvlib__Characterization Data.gtype"[], "FPGA Current Version": u32, "FPGA Oldest Compatible Version": u32, "Fixed Logic Current Version": u32, "Fixed Logic Oldest Compatible Version": u32, "FPGA Radio Settings Bus Current Version": u32, "FPGA Radio Settings Bus Oldest Compatible Version": u32, "FPGA Board Config Current Version": u32, "FPGA Board Config Oldest Compatible Version": u32, "Daughterboard Clock Rate": u32}
  "802.11 Host Session.gtype" = cluster{"FPGA interface": "802.11 FGPA Reference.gtype", "send queue": Queue<u8[]>, "receive queue": Queue<u8[]>, "receive throughput queue": Queue<T1>, "UDP Receiver": UdpNetworkConnectionRefnum, "PN packet": u8[], "FlexRIO session": Queue<T2>, "FlexRIO TX Characterization Data": T4, "FlexRIO RX Characterization Data": T4, "USRP session": "niUsrpRio Config v1 Host.lvlib__niUsrpRio Session.gtype", "RF loop clock frequency": f64, "send queue_2": Queue<u8[]>, "send queue_3": Queue<u8[]>, "send queue_4": Queue<u8[]>, "send queue_5": Queue<u8[]>, "UDP Receiver_2": UdpNetworkConnectionRefnum, "UDP Receiver_3": UdpNetworkConnectionRefnum, "UDP Receiver_4": UdpNetworkConnectionRefnum, "UDP Receiver_5": UdpNetworkConnectionRefnum}
diagram:
  Property Node(instance in=$"session in") -> ("UDP Receiver"=w1, "UDP Receiver_2"=w2, "UDP Receiver_3"=w3, "UDP Receiver_4"=w4, "UDP Receiver_5"=w5, instance out=w6)
  Udp Close(connection ID=w1, error in=$"error in") -> (error out=w7)
  call "Clear Errors.gvi"(specific error code to clear=1, error in=w7) -> (error out=w8)
  Udp Open(error in=w8, net address=0, port=$"receive port", service name="", timeout ms=25000) -> (connection ID=w9, error out=w10)
  Property Node(instance in=w10) -> ("code"=w11, instance out=w12)
  case (w11) {
    frame 0, Default {
      w16 = 0xFFFF  # level SOL_SOCKET
      w17 = 1024000  # buffer size in bytes
      w18 = 0x1002  # optname SO_RCVBUF
      call "Set Socket Option.gvi"(connection in=w9, level=w16, option name=w18, value=w17, error in=w12) -> (error out=w14, connection out=w13)
      w15 = TRUE
    }
    frame 60 {
      call "Clear Errors.gvi"(specific error code to clear=w11, error in=w12) -> (error out=w14)
      w19 = "The specified port or network address is currently in use, e.g. by another instance of this VI. Select an available port or network address."
      One Button Dialog(message=w19)
      w13 = w9
      w15 = default
    }
  }
  Udp Close(connection ID=w2, error in=$"error in") -> (error out=w20)
  call "Clear Errors.gvi"(specific error code to clear=1, error in=w20) -> (error out=w21)
  Udp Open(error in=w21, net address=0, port=$"receive port_2", service name="", timeout ms=25000) -> (connection ID=w22, error out=w23)
  Property Node(instance in=w23) -> ("code"=w24, instance out=w25)
  case (w24) {
    frame 0, Default {
      w29 = 0xFFFF  # level SOL_SOCKET
      w30 = 1024000  # buffer size in bytes
      w31 = 0x1002  # optname SO_RCVBUF
      call "Set Socket Option.gvi"(connection in=w22, level=w29, option name=w31, value=w30, error in=w25) -> (error out=w27, connection out=w26)
      w28 = TRUE
    }
    frame 60 {
      call "Clear Errors.gvi"(specific error code to clear=w24, error in=w25) -> (error out=w27)
      w32 = "The specified port or network address is currently in use, e.g. by another instance of this VI. Select an available port or network address."
      One Button Dialog(message=w32)
      w26 = w22
      w28 = default
    }
  }
  Udp Close(connection ID=w3, error in=$"error in") -> (error out=w33)
  call "Clear Errors.gvi"(specific error code to clear=1, error in=w33) -> (error out=w34)
  Udp Open(error in=w34, net address=0, port=$"receive port_3", service name="", timeout ms=25000) -> (connection ID=w35, error out=w36)
  Property Node(instance in=w36) -> ("code"=w37, instance out=w38)
  case (w37) {
    frame 0, Default {
      w42 = 0xFFFF  # level SOL_SOCKET
      w43 = 1024000  # buffer size in bytes
      w44 = 0x1002  # optname SO_RCVBUF
      call "Set Socket Option.gvi"(connection in=w35, level=w42, option name=w44, value=w43, error in=w38) -> (error out=w40, connection out=w39)
      w41 = TRUE
    }
    frame 60 {
      call "Clear Errors.gvi"(specific error code to clear=w37, error in=w38) -> (error out=w40)
      w45 = "The specified port or network address is currently in use, e.g. by another instance of this VI. Select an available port or network address."
      One Button Dialog(message=w45)
      w39 = w35
      w41 = default
    }
  }
  Udp Close(connection ID=w4, error in=$"error in") -> (error out=w46)
  call "Clear Errors.gvi"(specific error code to clear=1, error in=w46) -> (error out=w47)
  Udp Open(error in=w47, net address=0, port=$"receive port_4", service name="", timeout ms=25000) -> (connection ID=w48, error out=w49)
  Property Node(instance in=w49) -> ("code"=w50, instance out=w51)
  case (w50) {
    frame 0, Default {
      w55 = 0xFFFF  # level SOL_SOCKET
      w56 = 1024000  # buffer size in bytes
      w57 = 0x1002  # optname SO_RCVBUF
      call "Set Socket Option.gvi"(connection in=w48, level=w55, option name=w57, value=w56, error in=w51) -> (error out=w53, connection out=w52)
      w54 = TRUE
    }
    frame 60 {
      call "Clear Errors.gvi"(specific error code to clear=w50, error in=w51) -> (error out=w53)
      w58 = "The specified port or network address is currently in use, e.g. by another instance of this VI. Select an available port or network address."
      One Button Dialog(message=w58)
      w52 = w48
      w54 = default
    }
  }
  Udp Close(connection ID=w5, error in=$"error in") -> (error out=w59)
  call "Clear Errors.gvi"(specific error code to clear=1, error in=w59) -> (error out=w60)
  Udp Open(error in=w60, net address=0, port=$"receive port_5", service name="", timeout ms=25000) -> (connection ID=w61, error out=w62)
  Property Node(instance in=w62) -> ("code"=w63, instance out=w64)
  case (w63) {
    frame 0, Default {
      w68 = 0xFFFF  # level SOL_SOCKET
      w69 = 1024000  # buffer size in bytes
      w70 = 0x1002  # optname SO_RCVBUF
      call "Set Socket Option.gvi"(connection in=w61, level=w68, option name=w70, value=w69, error in=w64) -> (error out=w66, connection out=w65)
      w67 = TRUE
    }
    frame 60 {
      call "Clear Errors.gvi"(specific error code to clear=w63, error in=w64) -> (error out=w66)
      w71 = "The specified port or network address is currently in use, e.g. by another instance of this VI. Select an available port or network address."
      One Button Dialog(message=w71)
      w65 = w61
      w67 = default
    }
  }
  w72 = 4061  # packet size in byte
  call "802.11 Random Bit Generator.gvi"(packet size=w72) -> (random array=w73)
  Property Node(instance in=w6, "UDP Receiver"=w13, "PN packet"=w73, "UDP Receiver_2"=w26, "UDP Receiver_3"=w39, "UDP Receiver_4"=w52, "UDP Receiver_5"=w65) -> (instance out=w74)
  $"session out" <- w74
  Merge Errors(w14, w27, w40, w53, w66) -> (error out=w75)
  $"error out" <- w75
  Logical Or(w15, w28, w41, w54, w67) -> w76
  $"success?" <- w76
