vi "SEND UDP DATA VICTOR.gvi"   [LabVIEW Communications System Design Suite 2.0.1]
inputs:
  "UDP Sink Port Selection": string
  "Transmit IP Address": string
  "UDP Sink Ports": u16[]
  "Enable": bool
  "error in": error
  "UDP sender": UdpNetworkConnectionRefnum
  "receive queue": Queue<u8[]>
  "receive queue_2": Queue<u8[]>
  "receive queue_3": Queue<u8[]>
  "receive queue_4": Queue<u8[]>
  "receive queue_5": Queue<u8[]>
  "UDP sender_2": UdpNetworkConnectionRefnum
  "UDP sender_3": UdpNetworkConnectionRefnum
  "UDP sender_4": UdpNetworkConnectionRefnum
  "UDP sender_5": UdpNetworkConnectionRefnum
  "error in_2": error
  "error in_3": error
  "error in_4": error
  "error in_5": error
outputs:
  "Error Out": error
  "Data Transfer": bool
  "FIFO Full": bool
  "UDP sender dup": UdpNetworkConnectionRefnum
diagram:
  Array Index(array=$"UDP Sink Ports") -> (out0[0]=w1)
  call "802.11 Send UDP Data.gvi"(target port=w1, target IP address=$"Transmit IP Address", receive queue=$"receive queue", UDP sender=$"UDP sender", enable=$Enable, error in=$"error in") -> (FIFO full=w2, error out=w3, UDP sender dup=w4, data transfer=w5)
  Array Index(array=$"UDP Sink Ports") -> (out0[1]=w6)
  call "802.11 Send UDP Data.gvi"(target port=w6, target IP address=$"Transmit IP Address", receive queue=$"receive queue_2", UDP sender=$"UDP sender_2", enable=$Enable, error in=$"error in_2") -> (FIFO full=w7, error out=w8, UDP sender dup=w9, data transfer=w10)
  Array Index(array=$"UDP Sink Ports") -> (out0[2]=w11)
  call "802.11 Send UDP Data.gvi"(target port=w11, target IP address=$"Transmit IP Address", receive queue=$"receive queue_3", UDP sender=$"UDP sender_3", enable=$Enable, error in=$"error in_3") -> (FIFO full=w12, error out=w13, UDP sender dup=w14, data transfer=w15)
  Array Index(array=$"UDP Sink Ports") -> (out0[3]=w16)
  call "802.11 Send UDP Data.gvi"(target port=w16, target IP address=$"Transmit IP Address", receive queue=$"receive queue_4", UDP sender=$"UDP sender_4", enable=$Enable, error in=$"error in_4") -> (FIFO full=w17, error out=w18, UDP sender dup=w19, data transfer=w20)
  Array Index(array=$"UDP Sink Ports") -> (out0[4]=w21)
  call "802.11 Send UDP Data.gvi"(target port=w21, target IP address=$"Transmit IP Address", receive queue=$"receive queue_5", UDP sender=$"UDP sender_5", enable=$Enable, error in=$"error in_5") -> (FIFO full=w22, error out=w23, UDP sender dup=w24, data transfer=w25)
  case ($"UDP Sink Port Selection") {
    frame "A", Default {
      w26 = w3
      w27 = w4
      w28 = w5
      w29 = w2
    }
    frame "B" {
      w26 = w8
      w27 = w9
      w28 = w10
      w29 = w7
    }
    frame "C" {
      w26 = w13
      w27 = w14
      w28 = w15
      w29 = w12
    }
    frame "D" {
      w26 = w18
      w27 = w19
      w28 = w20
      w29 = w17
    }
    frame "E" {
      w26 = w23
      w27 = w24
      w28 = w25
      w29 = w22
    }
  }
  $"UDP sender dup" <- w27
  $"Data Transfer" <- w28
  $"FIFO Full" <- w29
  $"Error Out" <- w26
