vi "Send TX ICP_4.gvi"   [LabVIEW Communications System Design Suite 2.0.1]
inputs:
  "format": enum{"a", "ac"} = "a"  # The 802.11 format to use (currently a or ac).
  "bandwidth": enum{"20 MHz", "40 MHz", "80 MHz"} = "20 MHz"  # Bandwidth for the current packet. Enumeration type: 20 MHz, 40 MHz, 80 MHz
  "MCS": UFXP(4.0)  # Modulation and coding scheme index. Depending on the current 802.11 format (a or ac) and the bandwidth, valid indexes range from 0 to 7, 8 or 9.
  "device MAC address": u8[6] = [71, 111, 75, 117, 109, 97]  # Device MAC address used in the MAC frame header during transmission.
  "destination MAC address": u8[6] = [71, 111, 75, 117, 109, 98]  # Destination MAC address used in the MAC frame header during transmission.
  "payload": u8[]  # Payload to be transferred to the target MAC TX.
  "FPGA interface": "802.11 FGPA Reference.gtype"  # Interface to the device's FPGA handle.
  "error in": error
outputs:
  "dropped?": bool  # Indicates that the payload was not forwarded to TX Data DMA FIFO because the FIFO was full.
  "FPGA Interface dup": "802.11 FGPA Reference.gtype"  # Interface to the device's FPGA handle.
  "error out": error
diagram:
  Feedback Node(initial value=0xFFFFFFFF, input=w1) -> w2
  # Leave space
  # for more than
  # one A-MPDU.
  Is Greater(x=w2, y=10000) -> w3
  Not(x=w3) -> w4
  $"dropped?" <- w4
  # Create MPDU
  w5 = 1  # power level
  w6 = 1  # scrambler seed
  call "802.11 PHY Parameter to U8.gvi"(format=$format, bandwidth=$bandwidth, MCS=$MCS) -> (sample=w7)
  Build Array[ConcatenateInputs=True](w7, w5, w6, $"device MAC address", $"destination MAC address", $payload) -> w8
  Array Size(array=w8) -> (size(s)=w9)
  To Unsigned Long Integer(number=w9) -> w10
  Split Number(x=w10) -> (high(x)=w11, low(x)=w12)
  # prepend packet size
  Split Number(x=w11) -> (high(x)=w13, low(x)=w14)
  Split Number(x=w12) -> (high(x)=w15, low(x)=w16)
  Build Array[ConcatenateInputs=True](w13, w14, w15, w16, w8) -> w17
  case (w3) {
    frame False, Default {
      # Write empty array
      # to figure out free
      # elements.
      Host Fifo Write Node[FifoName="802.11 AFW Resources.grsc\\H2T TX Data_5"](data=u8[] [], error in=$"error in", reference in=$"FPGA interface", timeout (ms)=5000) -> (empty elements remaining=w1, error out=w18, reference out=w19)
    }
    frame True {
      Host Fifo Write Node[FifoName="802.11 AFW Resources.grsc\\H2T TX Data_5"](data=w17, error in=$"error in", reference in=$"FPGA interface", timeout (ms)=5000) -> (empty elements remaining=w1, error out=w18, reference out=w19)
    }
  }
  $"FPGA Interface dup" <- w19
  $"error out" <- w18
