vi "802.11 FPGA STA.gvi"   [LabVIEW Communications System Design Suite 2.0.1]
panel controls:
  "reg.host read.go rcvd 0": bool
  "reg.notify host.go rcvd 0": bool
  "reg.reset 0": bool
  "RF 0/Rx/Enable": bool
  "RF 0/Tx/Enable": bool
  "RF 1/Rx/Enable": bool
  "RF 1/Tx/Enable": bool
  "ATR State": enum{"Idle", "Rx", "Tx", "Duplex"} = "Idle"
  "Radio Control Destination": T1 = "Radio 0 Config"
  "lo lpf enable": bool
  "power enable": bool
  "mixer enable": bool
  "tx.configuration": T2 = {"power enable"=TRUE, "mixer enable"=TRUE, "gain"=0}
  "RX data source": T3 = "RF"
  "packet start sample index": u16
  "rearm packet start generator": bool
  "bypass synchronization": bool
  "reset MAC RX statistics": bool
  "noise coefficient": FXP(8.8) = 10
  "mute RX while TX active?": bool = TRUE
  "number of samples to capture": u16 = 1024
  "produce silent samples": bool
  "MPDU filter config": T7 = {"remove header"=TRUE, "block unsupported frame types"=TRUE, "block FCS errors"=TRUE, "block address mismatch"=TRUE, "block header recognize error"=TRUE}
  "power calibration offset": FXP(10.3)
  "CCA energy detect threshold": FXP(10.3) = -62
  "RF gain": FXP(10.3)
  "number of samples before trigger": u16
  "synchronization settings": T8 = {"maximal normalization threshold"=65536, "peak timing metric threshold"=0.5, "consecutive samples over threshold"=10, "valley timing metric threshold"=-0.5, "consecutive samples under threshold"=10, "autocorelation threshold"=0.5, "expected peak valley distance"=608, "maximum peak valley distance deviation"=64, "samples to shift frame start"=-32, "use static CFO?"=FALSE, "static CFO"=0}
  "trigger condition": T9 = "Immediate"
  "manual trigger": bool
  "AGC tresholds": T10
  "AGC timeout": i32 = 3500
  "enable AGC": bool
  "manual PhyTxStart.req": cluster{"TX vector": T11, "Valid": bool}
  "bypass MAC TX": bool
  "RX TX turnaround time": u32 = 24
  "reset MAC TX statistics": bool
  "suppress ACK": bool
  "backoff value": u16
  "ACK bandwidth": enum{"20 MHz", "40 MHz", "80 MHz"} = "20 MHz"
  "rx.reset": bool = TRUE
  "rx.output sample rate": UFXP(1.47)
  "rx.delay": FXP(0.16)
  "rx 0.frequency shift": FXP(0.48)
  "rx 0.phase": FXP(0.21)
  "rx 0.impairments": T13 = {"inline gain I"=-1, "inline gain Q"=0.999992370605, "cross gain I"=0.999992370605, "cross gain Q"=0, "pre-gain offset I"=0, "pre-gain offset Q"=-1, "post-gain offset I"=0, "post-gain offset Q"=0.999992370605}
  "rx.abort": bool
  "tx.abort": bool
  "tx.reset": bool = TRUE
  "tx.input sample rate": UFXP(1.47)
  "tx.delay": FXP(0.18)
  "tx 0.frequency shift": FXP(0.48)
  "tx 0.phase": FXP(0.21)
  "tx 0.impairments": T13 = {"inline gain I"=0.999992370605, "inline gain Q"=0.999992370605, "post-gain offset I"=0.999992370605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}
  "tx 0.gain": T14 = {"gain I"=1, "gain Q"=1}
  "rx 1.impairments": T13 = {"inline gain I"=-0.999992370605, "inline gain Q"=0.999992370605, "cross gain I"=-0.999992370605, "cross gain Q"=0, "pre-gain offset I"=-1, "pre-gain offset Q"=0, "post-gain offset I"=0, "post-gain offset Q"=0}
  "rx 1.frequency shift": FXP(0.48)
  "rx 1.phase": FXP(0.21)
  "tx 1.impairments": T13 = {"inline gain I"=0.999992370605, "inline gain Q"=0.999992370605, "post-gain offset I"=-1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}
  "tx 1.frequency shift": FXP(0.48)
  "tx 1.phase": FXP(0.21)
  "tx 1.gain": T14 = {"gain I"=1, "gain Q"=1}
  "rx 0.stream enable": bool
  "rx 1.stream enable": bool
  "tx 0.stream enable": bool
  "tx 1.stream enable": bool
  "Data clock cycles per tick (0.1us)": u16 = 20
  "Data clock cycles per OFDM symbol": u16 = 480
  "rx.rf channel": UFXP(1.0)
  "tx.rf channel": UFXP(1.0)
  "enable DC offset correction": bool = TRUE
  "data clock locked?": bool
  "format": enum{"a", "ac"} = "a"
  "channel selector": UFXP(2.0)
  "device MAC address": u8[6]
  "DC centered signal": bool = TRUE
  "daughterboard": "niUsrpRio Config v1 Host.lvlib__DB Types.gtype" = "sbx"
  "antenna configuration": "niUsrpRio Config v1 Host.lvlib__Antenna Configuration.gtype" = "TX1 RX1 transmits and RX2 receives"
  "spi address": u8 = 7
  "cpld enable": bool = TRUE
  "Force H2T ID": u8
  "Force manual ID": bool
  "Number of Streams": u8
  "Scheduling Algorithm": enum{"Round Robin", "HDR-VBR"} = "Round Robin"
panel indicators:
  "reg.notify host.go 0": bool
  "reg.host read.data 0": cluster{"go": bool, "data": u32}
  "compensated CFO": FXP(0.48)
  "MAC RX statistics": T4
  "PhyRxStart.ind": T5
  "PhyRxEnd.ind": T6
  "T2H RX Data overflow": u16
  "T2H Constallation overflow": u16
  "T2H RX Bit Processing Output FIFO overflow": u16
  "T2H RX Power Spectrum overflow": u16
  "T2H Channel Estimation overflow": u16
  "last applied gain": UFXP(5.1)
  "RF input power at packet start": FXP(10.3)
  "signal power at packet start": FXP(10.3)
  "RF input power": FXP(10.3)
  "signal power": FXP(10.3)
  "out of range?": bool
  "MAC TX statistics": T12
  "PhyTxStart.req": cluster{"TX vector": T11, "Valid": bool}
  "PhyTxEnd.ind": cluster{"Valid": bool}
  "internal loopback FIFO overflow": u16
  "TX to RF FIFO overflow": u16
  "T2H TX Baseband FIFO overflow": u16
  "T2H TX Bit Processing Output FIFO overflow": u16
  "rx.samples processed": u32
  "rx.number of IQ data overflows": u64
  "rx.number of overflows": u32
  "tx.samples processed": u32
  "tx.underflows": u32
  "tx.number of IQ data overflows": u64
  "rx.dsp reset done": bool
  "tx.dsp reset done": bool
  "tx.state": "Stream Control State.gtype"
  "rx.state": "Stream Control State.gtype"
  "Timestamp": u32
  "DC average": CFXP(1.17)
  "Scheduled ID": u8
  "[D] Ready for Scheduleing": bool
types:
  T1 = enum{"Identification", "Board Config", "Global Config", "Radio 0 Config", "Radio 1 Config", "Synchronization", "Time", "Future Events"}
  T2 = cluster{"power enable": bool, "mixer enable": bool, "gain": u8}
  T3 = enum{"RF", "BB Data From Host", "Internal Loopback"}
  T4 = cluster{"number of frames detected": u32, "number of subframes received": u32, "number of valid subframes received": u32, "number of ACKs received": u32, "valid": bool}
  T5 = cluster{"Format": enum{"a", "ac"}, "Bandwidth": enum{"20 MHz", "40 MHz", "80 MHz"}, "PSDU Length": u32, "MCS": UFXP(4.0), "valid": bool}
  T6 = cluster{"Format Violation": bool, "Timing valid": bool, "Timing value": u32, "valid": bool}
  T7 = cluster{"remove header": bool, "block unsupported frame types": bool, "block FCS errors": bool, "block address mismatch": bool, "block header recognize error": bool}
  T8 = cluster{"maximal normalization threshold": UFXP(19.15), "peak timing metric threshold": FXP(2.6), "consecutive samples over threshold": u8, "valley timing metric threshold": FXP(2.6), "consecutive samples under threshold": u8, "autocorelation threshold": UFXP(2.14), "expected peak valley distance": u16, "maximum peak valley distance deviation": u8, "samples to shift frame start": i8, "use static CFO?": bool, "static CFO": FXP(0.48)}
  T9 = enum{"Immediate", "RX Packet Start", "TX Paket Start", "CCA energy detected"}
  T10 = cluster{"AGC active threshold": FXP(10.3), "AGC threshold 1": FXP(10.3), "AGC threshold 2": FXP(10.3), "AGC threshold 3": FXP(10.3)}
  T11 = cluster{"format": enum{"a", "ac"}, "bandwidth": enum{"20 MHz", "40 MHz", "80 MHz"}, "length": u32, "MCS": UFXP(4.0), "TX power level": UFXP(4.0), "Scrambler seed": UFXP(7.0)}
  T12 = cluster{"number of TX after SIFS requests detected": u32, "number of TX after SIFS requests completed": u32, "number of TX after backoff requests detected": u32, "number of TX after backoff requests completed": u32}
  T13 = cluster{"inline gain I": FXP(1.17), "inline gain Q": FXP(1.17), "cross gain I": FXP(1.17), "cross gain Q": FXP(1.17), "pre-gain offset I": FXP(1.17), "pre-gain offset Q": FXP(1.17), "post-gain offset I": FXP(1.17), "post-gain offset Q": FXP(1.17)}
  T14 = cluster{"gain I": FXP(3.21), "gain Q": FXP(3.21)}
  "Stream Control State.gtype" = enum{"Idle", "Active"}
  "niUsrpRio Config v1 Host.lvlib__DB Types.gtype" = enum{"sbx", "cbx", "wbx", "unknown", "ubx"}
  "niUsrpRio Config v1 Host.lvlib__Antenna Configuration.gtype" = enum{"TX1 RX1 transmits and RX2 receives", "TX1 RX1 receives and RX2 is unused"}
  T15 = cluster{"CCA energy detection busy": u8, "CCA signal detection busy": bool}
  T16 = cluster{"CCA energy detection busy": u8, "CCA signal detection busy": bool, "frame timing valid": bool, "frame timing value": u32, "frame timing use DIFS": bool}
  T17 = enum{"Idle", "Wait for second measurement", "AGC active", "Gain locked"}
  T18 = cluster{"trigger gain setting": bool, "gain": UFXP(5.1)}
  "802.11 PHY-SAP.gtype" = cluster{"PSDU (RX)": any, "PSDU (TX)": any, "CCA detection": RegisterDataType<T15>, "PhyRxStart.req": HandshakeDataType<T5>, "PhyRxEnd.ind": HandshakeDataType<T6>, "channel state indication": HandshakeDataType<T16>, "PhyTxStart.req": HandshakeDataType<cluster{"TX vector": T11, "Valid": bool}>, "PhyTxEnd.ind": HandshakeDataType<cluster{"Valid": bool}>, "PHY RX AGC state indication": HandshakeDataType<cluster{"AGC state": T17, "AGC enabled": bool}>, "PHY RX Gain change indication": HandshakeDataType<T18>}
  T19 = cluster{"MPDU subtype": enum{"ACK"}, "destination MAC address": u8[6], "valid": bool}
  T20 = cluster{"5 MHz": bool, "10 MHz": bool, "20 MHz": bool, "40 MHz": bool, "80 Mhz": bool, "160 MHz": bool}
  T21 = cluster{"format": enum{"a", "ac"}, "channel selector": UFXP(2.0), "device MAC address": u8[6], "DC centered signal": bool, "supported bandwidths": T20}
  T22 = cluster{"global timestamp": RegisterDataType<u32>, "OFDM symbol pulse": RegisterDataType<bool>, "TX active": RegisterDataType<bool>, "channel state indication": RegisterDataType<T16>, "MPDU generation request": RegisterDataType<T19>, "shared properties": RegisterDataType<T21>}
  "RX to Tx Wn Data.gtype" = cluster{"ID Array": u8[], "Wn Array": i32[]}
  "H2T TX Data FIFOs.gtype" = cluster{"H2T TX Data": any, "H2T TX Data_2": any, "H2T TX Data_3": any, "H2T TX Data_4": any, "H2T TX Data_5": any}
  T23 = cluster{"RF to RX FIFO": any, "internal loopback FIFO": any, "TX to RF FIFO": any, "Gain Settings FIFO": any}
  T24 = cluster{"output sample rate": UFXP(1.47), "delay": FXP(0.16), "frequency shift": FXP(0.48), "impairments": T13, "phase": FXP(0.21)}
  T25 = cluster{"frequency shift": FXP(0.48), "impairments": T13, "phase": FXP(0.21), "input sample rate": UFXP(1.47), "gain": T14, "delay": FXP(0.18)}
diagram:
  FIFO Create(data type=u8 0) -> (reference out=w1)
  FIFO Create(data type=u8 0) -> (reference out=w2)
  Register Create(initial value=T15 {all zero or empty}) -> (reference out=w3)
  Handshake Create(data type=T5 {all zero or empty}) -> (reference out=w4)
  Handshake Create(data type=T6 {all zero or empty}) -> (reference out=w5)
  Handshake Create(data type=T16 {all zero or empty}) -> (reference out=w6)
  Handshake Create(data type=cluster{"TX vector": T11, "Valid": bool} {all zero or empty}) -> (reference out=w7)
  Handshake Create(data type=cluster{"Valid": bool} {all zero or empty}) -> (reference out=w8)
  w9 = cluster{"AGC state": T17, "AGC enabled": bool} {all zero or empty}
  Handshake Create(data type=w9) -> (reference out=w10)
  Handshake Create(data type=T18 {all zero or empty}) -> (reference out=w11)
  Property Node(instance in="802.11 PHY-SAP.gtype" {all zero or empty}, "PSDU (RX)"=w1, "PSDU (TX)"=w2, "CCA detection"=w3, "PhyRxStart.req"=w4, "PhyRxEnd.ind"=w5, "channel state indication"=w6, "PhyTxStart.req"=w7, "PhyTxEnd.ind"=w8, "PHY RX AGC state indication"=w10, "PHY RX Gain change indication"=w11) -> (instance out=w12)
  Register Create(initial value=0) -> (reference out=w13)
  Register Create(initial value=FALSE) -> (reference out=w14)
  w15 = T19 {"MPDU subtype"="ACK", "destination MAC address"=[0, 0, 0, 0, 0, 0], "valid"=FALSE}
  Register Create(initial value=w15) -> (reference out=w16)
  Register Create(initial value=FALSE) -> (reference out=w17)
  Register Create(initial value=T16 {all zero or empty}) -> (reference out=w18)
  w19 = T21 {"format"="a", "channel selector"=0, "device MAC address"=[0, 0, 0, 0, 0, 0], "DC centered signal"=FALSE, "supported bandwidths"={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}}
  Register Create(initial value=w19) -> (reference out=w20)
  Property Node(instance in=T22 {all zero or empty}, "global timestamp"=w13, "MPDU generation request"=w16, "channel state indication"=w18, "TX active"=w17, "OFDM symbol pulse"=w14, "shared properties"=w20) -> (instance out=w21)
  clock-driven loop (clock = "802.11 AFW Resources.grsc\\MAC") forever {
    call "802.11 PHY-SAP Read MAC.gcdl"(PHY-SAP=w12) -> (CCA detection=w22, PSDU=w23, PSDU valid=w24, PhyRxStart.req=w25, PhyTxEnd.ind=w26, PhyRxEnd.ind=w27, PHY RX AGC state indication=w28, PHY RX Gain change indication=w29)
    Property Node(instance in=w25) -> ("valid"=w30)
    Feedback Node(enable?=w30, initial value=u8[6] default, input=w31) -> w32
    call "802.11 MAC RX.gcdl"(PSDU=w23, input valid=w24, PHY RX start indication=w25, PHY RX end indication=w27, PHY CCA timing indication=w22, reset MAC RX statistics=$"reset MAC RX statistics", device MAC address=w32, MPDU filter config=$"MPDU filter config") -> (MAC RX statistics=w33, channel state indication=w34, ICP SDU=w35, output valid=w36, MPDU generation request=w37)
    call "802.11 RX Data Sink.gcdl"(ICP SDU=w35, input valid=w36, FIFO reference="802.11 AFW Resources.grsc\\T2H RX Data") -> (FIFO overflow count=w38)
    $"T2H RX Data overflow" <- w38
    Initialize Array(element=0, size=5) -> w39
    Initialize Array(element=0, size=5) -> w40
    Property Node(instance in="RX to Tx Wn Data.gtype" {all zero or empty}, "ID Array"=w39, "Wn Array"=w40) -> (instance out=w41)
    Feedback Node(input=w42) -> w43
    call "FPGA MAC Scheduler.gcdl"(Force H2T ID=$"Force H2T ID", Force manual ID=$"Force manual ID", Was ACK received before deadline?=TRUE, Ready for scheduling=w43, Wn Data=w41, Scheduling Algorithm=$"Scheduling Algorithm", Number of Streams=$"Number of Streams") -> (Scheduled ID=w44, ReTX=w45)
    $"Scheduled ID" <- w44
    w46 = "H2T TX Data FIFOs.gtype" {"H2T TX Data"="802.11 AFW Resources.grsc\\H2T TX Data", "H2T TX Data_2"="802.11 AFW Resources.grsc\\H2T TX Data_2", "H2T TX Data_3"="802.11 AFW Resources.grsc\\H2T TX Data_3", "H2T TX Data_4"="802.11 AFW Resources.grsc\\H2T TX Data_4", "H2T TX Data_5"="802.11 AFW Resources.grsc\\H2T TX Data_5"}
    # Temporary
    # Week 3 Implementation
    Property Node(instance in=w46) -> ("H2T TX Data"=w47)
    Property Node(instance in=w21) -> ("shared properties"=w48, "global timestamp"=w49, "channel state indication"=w50)
    Register Read(reference in=w49) -> (data=w51)
    # w52: channel state indication
    Register Write(data=w34, reference in=w50) -> (reference out=w52)
    # w51: global time reference
    Register Read(reference in=w52) -> (data=w53)
    Register Read(reference in=w48) -> (data=w54)
    Property Node(instance in=w54) -> ("format"=w55, "device MAC address"=w31)
    # w37: MPDU request
    Feedback Node(input=w56) -> w57
    call "802.11 Prepare ACK.gcdl"(format=w55, bandwidth=$"ACK bandwidth", MPDU generation request=w37, MAC ready=w57, suppress=$"suppress ACK") -> (MPDU block=w58, output valid=w59, TX after SIFS request=w60)
    Feedback Node(input=w61) -> w62
    call "TX Data Source Multiple.gcdl"(bypass MAC TX=$"bypass MAC TX", Scheduled ID=w44, ReTX=w45, H2T TX Data Queues=w46, scheduling done=TRUE, ReTX Data FIFO=w47, ready for output=w62) -> (ICP data=w63, output valid=w64, elements available=w65)
    Feedback Node(input=w66) -> w67
    Feedback Node(input=w68) -> w69
    call "802.11 Prepare MPDU.gcdl"(ICP=w63, input valid=w64, elements available=w65, MAC ready for input=w67, TX status indication=w69, backoff value=$"backoff value") -> (MPDU block=w70, ready for input=w61, output valid=w71, TX after backoff request=w72, ready for scheduling=w42)
    Logical Or(w58, w70) -> w73
    Logical Or(w59, w71) -> w74
    Feedback Node(input=w75) -> w76
    call "802.11 MAC TX.gcdl"(TX after backoff request=w72, TX after SIFS request=w60, channel state indication=w53, global clock value=w51, RX TX turnaround time in global clock ticks=$"RX TX turnaround time", PSDU data ready for input=w76, PHY TX end indication=w26, MPDU block=w73, input valid=w74, reset MAC TX statistics=$"reset MAC TX statistics") -> (MPDU=w77, output valid=w78, PHY TX start request=w79, TX after SIFS data ready for input=w56, TX after backoff data ready for input=w66, TX status indication=w68, MAC TX statistics=w80)
    call "TX MAC Bypass VICTOR.gcdl"(manual PhyTxStart.req=$"manual PhyTxStart.req", ReTX Data FIFO=w47, Scheduled ID=w44, ReTX=w45, H2T TX Data Queues=w46, ready for output=w76, bypass MAC TX=$"bypass MAC TX", MPDU=w77, input valid=w78, request in=w79) -> (request out=w81, output valid=w82, PSDU=w83)
    call "802.11 PHY-SAP Write MAC.gcdl"(PHY-SAP=w12, PhyTxStart.req=w81, PSDU=w83, PSDU valid=w82, channel state indication=w34) -> (PSDU TX ready for input=w75)
    $"MAC RX statistics" <- w33
    call "802.11 Write RX Events.gcdl"(global timestamp=w51, PHY RX start indication=w25, PHY RX end indication=w27, MAC channel state indication=w34, PHY CCA timing indication=w22, T2H FIFO reference="802.11 AFW Resources.grsc\\T2H Events", PHY RX Gain change indication=w29, PHY RX AGC state indication=w28)
    $"MAC TX statistics" <- w80
    $"[D] Ready for Scheduleing" <- w43
    call "802.11 Capture PHY TX Indications.gcdl"(PHY TX end indication in=w26, PHY TX start request in=w81) -> (PHY TX start request out=w84, PHY TX end indication out=w85)
    $"PhyTxStart.req" <- w84
    $"PhyTxEnd.ind" <- w85
    call "802.11 Write TX Events.gcdl"(global time reference=w51, PHY TX end indication=w26, PHY TX start request=w81, TX status indication=w68, T2H FIFO reference="802.11 AFW Resources.grsc\\T2H Events")
  }
  FIFO Create(data type=CFXP(3.13) 0+0i, depth=17) -> (reference out=w86)
  FIFO Create(data type=CFXP(3.13) 0+0i, depth=1025) -> (reference out=w87)
  FIFO Create(data type=CFXP(3.13) 0+0i, depth=1025) -> (reference out=w88)
  FIFO Create(data type=UFXP(5.1) 0, depth=17) -> (reference out=w89)
  Property Node(instance in=T23 {all zero or empty}, "RF to RX FIFO"=w86, "internal loopback FIFO"=w87, "TX to RF FIFO"=w88, "Gain Settings FIFO"=w89) -> (instance out=w90)
  clock-driven loop (clock = "802.11 AFW Resources.grsc\\PHY") forever {
    Property Node(instance in=w21) -> ("global timestamp"=w91, "shared properties"=w92, "TX active"=w93, "OFDM symbol pulse"=w94)
    Register Read(reference in=w91) -> (data=w95)
    Property Node(instance in=w90) -> ("RF to RX FIFO"=w96, "internal loopback FIFO"=w97, "TX to RF FIFO"=w98, "Gain Settings FIFO"=w99)
    Register Read(reference in=w94) -> (data=w100, reference out=w101)
    Register Read(reference in=w92) -> (data=w102)
    # w100: Symbol trigger
    Property Node(instance in=w102) -> ("supported bandwidths"=w103, "DC centered signal"=w104, "channel selector"=w105)
    Feedback Node(input=w106) -> w107
    call "802.11 PHY-SAP Read PHY.gcdl"(PHY-SAP=w12, ready for output=w107) -> (PSDU=w108, PSDU valid=w109, PhyTxStart.req=w110)
    call "niInstr Basic Elements v1 FPGA.lvlib__Detect Rising Edge.gcdl"(signal=w100) -> (edge detected=w111)
    call "802.11 PHY TX Request Handler.gcdl"(symbol trigger in=w111, PhyTxStart.req=w110, supported bandwidths=w103) -> (symbol index=w112, symbol trigger out=w113, start of packet=w114, TX vector out=w115, PhyTxEnd.ind=w116, TX active=w117)
    Register Write(data=w117, reference in=w93) -> (reference out=w118)
    call "802.11 RX Data Source.gcdl"(RX data source=$"RX data source", mute RX while TX active?=$"mute RX while TX active?", TX active register=w118, RF to RX FIFO=w96, internal loopback FIFO=w97, OFDM symbol trigger register=w101, produce silent samples=$"produce silent samples", H2T FIFO="802.11 AFW Resources.grsc\\H2T RX Baseband") -> (sample=w119, output valid=w120)
    call "802.11 Signal Filter.gcdl"(sample in=w119, input valid=w120, configuration=w102) -> (20MHz sample out=w121, output valid=w122, 40MHz sample out=w123, 80MHz sample out=w124)
    Feedback Node(input=w125) -> w126
    call "802.11 Synchronization.gcdl"(bypass synchronization=$"bypass synchronization", rearm packet start generator=$"rearm packet start generator", packet start sample index=$"packet start sample index", synchronization settings=$"synchronization settings", rearm sychronization=w126, sample in=w119, input valid=w120, filtered sample=w121, filtered sample valid=w122) -> (sample out=w127, output valid=w128, packet start=w129, compensated CFO=w130, CCA signal detected=w131)
    w132 = T21 {"format"="a", "channel selector"=0, "device MAC address"=[0, 0, 0, 0, 0, 0], "DC centered signal"=FALSE, "supported bandwidths"={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}}
    Feedback Node(enable?=w129, initial value=w132, input=w102) -> w133
    Property Node(instance in=w133) -> ("format"=w134, instance out=w135)
    Feedback Node(input=w136) -> w137
    call "802.11 RX IQ Processing.gcdl"(sample=w127, input valid=w128, packet start=w129, configuration=w137) -> (subcarrier=w138, subcarrier timing=w139, subcarrier field map=w140, last sample received=w141, channel estimate=w142, channel estimate timing=w143)
    Feedback Node(input=w144) -> w145
    call "802.11 RX Bit Processing.gcdl"(subcarrier timing=w139, subcarrier=w138, field map=w140, configuration=w145, noise coefficient=$"noise coefficient") -> (current OFDM symbol=w146, PSDU=w147, bit=w148, bit valid=w149, last byte decoded=w150, PSDU valid=w151)
    call "802.11 RX PHY State Machine.gcdl"(bit=w148, bit valid=w149, shared properties=w135, current OFDM symbol=w146, last bit of packet decoded=w150, last sample of packet received=w141, global timestamp=w95) -> (RX bit processing configuration=w144, RX IQ processing configuration=w136, PhyRxStart.ind=w152, PhyRxEnd.ind=w153)
    Property Node(instance in=w153) -> ("valid"=w125)
    Feedback Node(input=w154) -> w155
    To Fixed Point(number=w155) -> w156: FXP(10.3) Saturate:ConvergentRounding
    Select(s=$"enable AGC", t=w156, f=$"RF gain") -> w157
    call "802.11 Power Measurement.gcdl"(sample=w124, input valid=w122, CCA energy detect threshold=$"CCA energy detect threshold", power calibration offset=$"power calibration offset", RF gain=w157, sample 20MHz filtered=w121, sample 40MHz filtered=w123) -> (signal power=w158, output valid=w159, out of range?=w160, CCA energy detect=w161, RF input power=w162)
    Property Node(instance in=T15 {all zero or empty}, "CCA energy detection busy"=w161, "CCA signal detection busy"=w131) -> (instance out=w163)
    call "802.11 AGC.gcdl"(signal power=w158, packet start=w129, rearm AGC=w126, AGC thresholds=$"AGC tresholds", AGC timeout=$"AGC timeout", signal power valid=w159, enable AGC=$"enable AGC") -> (gain=w164, trigger gain setting=w165, state=w166, last applied gain=w154)
    Property Node(instance in=T18 {all zero or empty}, "trigger gain setting"=w165, "gain"=w164) -> (instance out=w167)
    w168 = cluster{"AGC state": T17, "AGC enabled": bool} {all zero or empty}
    Property Node(instance in=w168, "AGC state"=w166, "AGC enabled"=$"enable AGC") -> (instance out=w169)
    call "802.11 PHY-SAP Write PHY.gcdl"(PHY-SAP=w12, PSDU valid=w151, PSDU=w147, CCA detection=w163, PhyRxEnd.ind=w153, PhyRxStart.ind=w152, PhyTxEnd.ind=w116, PHY RX Gain change indication=w167, PHY RX AGC state indication=w169)
    call "802.11 Prepare RX IQ Data for T2H.gcdl"(subcarrier=w138, timing=w139, field map=w140, FIFO reference="802.11 AFW Resources.grsc\\T2H Constellation") -> (FIFO overflow count=w170)
    $"T2H Constallation overflow" <- w170
    call "802.11 Prepare Channel Estimation for T2H.gcdl"(channel estimate=w142, timing=w143, format=w134, FIFO reference="802.11 AFW Resources.grsc\\T2H Channel Estimation") -> (FIFO overflow count=w171)
    $"T2H Channel Estimation overflow" <- w171
    call "802.11 Trigger Capture RX Samples.gcdl"(trigger condition=$"trigger condition", manual trigger=$"manual trigger", RX packet start=w129, TX active register=w118, CCA energy detected=w161) -> (trigger=w172)
    call "802.11 Capture RX Samples.gcdl"(sample=w127, input valid=w128, trigger=w172, number of samples to capture=$"number of samples to capture", FIFO reference="802.11 AFW Resources.grsc\\T2H RX Power Spectrum", number of samples before trigger=$"number of samples before trigger") -> (FIFO overflow count=w173)
    $"T2H RX Power Spectrum overflow" <- w173
    call "802.11 TX Bit Processing.gcdl"(symbol trigger=w113, OFDM symbol index=w112, TX vector=w115, PSDU=w108, input valid=w109) -> (bit=w174, output valid=w175, ready for input=w106, modulation=w176)
    call "802.11 TX IQ Processing.gcdl"(symbol trigger=w113, OFDM symbol index=w112, TX vector=w115, channel selector=w105, start of packet=w114, bit valid=w175, bit=w174, bit processing modulation=w176, DC centered signal=w104, supported bandwidths=w103) -> (data out=w177, output valid=w178)
    call "802.11 TX Data Sink.gcdl"(TX to RF FIFO=w98, internal loopback FIFO=w97, sample=w177, input valid=w178, T2H FIFO="802.11 AFW Resources.grsc\\T2H TX Baseband") -> (T2H FIFO overflow count=w179, TX to RF FIFO overflow count=w180, internal loopback FIFO overflow count=w181)
    $"T2H TX Baseband FIFO overflow" <- w179
    $"TX to RF FIFO overflow" <- w180
    $"compensated CFO" <- w130
    $"internal loopback FIFO overflow" <- w181
    call "802.11 RX Bit Processing Data Sink.gcdl"(PSDU=w147, input valid=w151, FIFO reference="802.11 AFW Resources.grsc\\T2H RX Bit Processing Output") -> (FIFO overflow count=w182)
    $"T2H RX Bit Processing Output FIFO overflow" <- w182
    call "802.11 TX Bit Processing Data Sink.gcdl"(bit=w174, input valid=w175, modulation=w176, FIFO reference="802.11 AFW Resources.grsc\\T2H TX Bit Processing Output") -> (FIFO overflow count=w183)
    $"T2H TX Bit Processing Output FIFO overflow" <- w183
    call "802.11 Capture PHY RX Indications.gcdl"(PHY RX start indication in=w152, PHY RX end indication in=w153) -> (PHY RX start indication out=w184, PHY RX end indication out=w185)
    $"PhyRxStart.ind" <- w184
    $"PhyRxEnd.ind" <- w185
    $"RF input power" <- w162
    Feedback Node(enable?=w129, input=w162) -> w186
    $"RF input power at packet start" <- w186
    $"signal power" <- w158
    Feedback Node(enable?=w129, input=w158) -> w187
    $"signal power at packet start" <- w187
    $"out of range?" <- w160
    FIFO Write(Control Protocol Input=w165, data=w164, reference in=w99)
    $"last applied gain" <- w154
  }
  call "Create Resources.gvi"() -> (config.resources=w188, sync.resources=w189, time.resources=w190)
  clock-driven loop (clock = "40 MHz Onboard Clock") {
    Io Write(data=$"RF 1/Rx/Enable", reference in="RF 1/Rx/Enable")
    Io Write(data=$"RF 0/Tx/Enable", reference in="RF 0/Tx/Enable")
    Io Write(data=$"RF 0/Rx/Enable", reference in="RF 0/Rx/Enable")
    Feedback Node(input=w191) -> w192
    Property Node(instance in=w90) -> ("Gain Settings FIFO"=w193)
    FIFO Read(Control Protocol Input=TRUE, reference in=w193) -> (Control Protocol Output=w191, data=w194)
    Feedback Node(enable?=w191, input=w194) -> w195
    To Fixed Point(number=w195) -> w196: UFXP(6.1) Wrap:Truncate
    # Register Bus and Required Controls/Indicators
    Scale By Power Of 2(n=1, x=w196) -> w197
    To Unsigned Byte Integer(number=w197) -> w198
    Property Node(instance in=T2 {"power enable"=TRUE, "mixer enable"=TRUE, "gain"=0}, "power enable"=$"power enable", "mixer enable"=$"mixer enable", "gain"=w198) -> (instance out=w199)
    call "Set Gain.gcdl"(ATR State=$"ATR State", Radio Control Destination=$"Radio Control Destination", FPGA.Fifo="802.11 AFW Resources.grsc\\AGC Reg Bus 0 Access FIFO", daughterboard=$daughterboard, antenna configuration=$"antenna configuration", Write ATR?=w192, lo lpf enable=$"lo lpf enable", rx.configuration=w199, tx.configuration=$"tx.configuration", spi address=$"spi address", cpld enable=$"cpld enable")
    Io Write(data=$"RF 1/Tx/Enable", reference in="RF 1/Tx/Enable")
    Feedback Node(input=w200) -> w201
    Property Node(instance in=w201) -> ("ready for port 0 input"=w202, "ready for port 1 input"=w203)
    Feedback Node(input=w204) -> w205
    call "niInstr Register Bus v1 FPGA.lvlib__Process.gcdl"(reg.notify host.go rcvd=$"reg.notify host.go rcvd 0", reg.host read.go rcvd=$"reg.host read.go rcvd 0", read completion=w205, reg.reset=$"reg.reset 0", reg.host instruction fifo="niInstr Register Bus v0.grsc\\reg.host instruction fifo 0", ready for output=w203) -> (reg.notify host.go=w206, reg.host read.data=w207, register instruction=w208)
    $"reg.notify host.go 0" <- w206
    $"reg.host read.data 0" <- w207
    FIFO Read(Control Protocol Input=w202, reference in="802.11 AFW Resources.grsc\\AGC Reg Bus 0 Access FIFO") -> (Control Protocol Output=w209, data=w210)
    call "Retrieve FPGA Scoped Instruction.gcdl"(number=w210, valid=w209) -> (output cluster=w211)
    Feedback Node(input=w212) -> w213
    call "niInstr Register Bus v1 FPGA.lvlib__Register Instruction Arbiter (2 inputs).gcdl"(port 0=w211, port 1=w208, reset=FALSE, ready for output=w213) -> (register instr out=w214, ready for input=w200)
    call "Registers.gcdl"(register instruction=w214, config.resources=w188, sync.resources=w189, time.resources=w190) -> (read completion out=w204, ready for input=w212)
    stop if FALSE
  }
  clock-driven loop (clock = "Data Clock") forever {
    # Baseband to/from RF conversion
    # Data Reception from Antenna, downconversion to baseband sample rate, received data will be written into RX baseband input FIFO
    # Reading of TX baseband FIFO, upconversion and transmission to antenna
    Property Node(instance in=w21) -> ("shared properties"=w215, "global timestamp"=w216, "OFDM symbol pulse"=w217)
    call "Mod N Indexer U16 v2.gcdl"(N=$"Data clock cycles per tick (0.1us)", enable=$"data clock locked?") -> (wrap back?=w218)
    call "niInstr Basic Elements v1 FPGA.lvlib__Count Up U32.gcdl"(increment=w218, reset=FALSE) -> (count out=w219)
    Register Write(data=w219, reference in=w216)
    call "Mod N Indexer U16 v2.gcdl"(N=$"Data clock cycles per OFDM symbol", enable=$"data clock locked?") -> (wrap back?=w220)
    Register Write(data=w220, reference in=w217)
    w221 = T20 {"5 MHz"=FALSE, "10 MHz"=FALSE, "20 MHz"=TRUE, "40 MHz"=TRUE, "80 Mhz"=FALSE, "160 MHz"=FALSE}
    w222 = T21 {"format"="a", "channel selector"=0, "device MAC address"=[0, 0, 0, 0, 0, 0], "DC centered signal"=FALSE, "supported bandwidths"={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}}
    Property Node(instance in=w222, "format"=$format, "channel selector"=$"channel selector", "device MAC address"=$"device MAC address", "DC centered signal"=$"DC centered signal", "supported bandwidths"=w221) -> (instance out=w223)
    Register Write(data=w223, reference in=w215)
    $Timestamp <- w219
    Property Node(instance in=w90) -> ("TX to RF FIFO"=w224, "RF to RX FIFO"=w225)
    Build Array($"rx 0.stream enable", $"rx 1.stream enable") -> w226
    w227 = T24 {"0x800000000000", 0, 0, "0x1FFFF", "0x1FFFF", 0, 0, 0, 0, 0, 0, 0}
    Property Node(instance in=w227, "impairments"=$"rx 0.impairments", "frequency shift"=$"rx 0.frequency shift", "phase"=$"rx 0.phase", "output sample rate"=$"rx.output sample rate", "delay"=$"rx.delay") -> (instance out=w228)
    w229 = T24 {"0x800000000000", 0, 0, "0x1FFFF", "0x1FFFF", 0, 0, 0, 0, 0, 0, 0}
    Property Node(instance in=w229, "delay"=$"rx.delay", "output sample rate"=$"rx.output sample rate", "impairments"=$"rx 1.impairments", "frequency shift"=$"rx 1.frequency shift", "phase"=$"rx 1.phase") -> (instance out=w230)
    Build Array(w228, w230) -> w231
    call "802.11 USRP Stream RX.gcdl"(RF to RX FIFO reference=w225, enable DC offset correction=$"enable DC offset correction", rx.reset=$"rx.reset", rx.rf channel=$"rx.rf channel", rx. stream enabled=w226, rx.abort=$"rx.abort", DDC parameters=w231) -> (rx.number of IQ data overflows=w232, rx.dsp reset done=w233, DC average=w234, rx.state=w235, rx.samples processed=w236, rx.number of overflows=w237)
    $"rx.number of IQ data overflows" <- w232
    Build Array($"tx 0.stream enable", $"tx 1.stream enable") -> w238
    w239 = T25 {0, "0x1FFFF", "0x1FFFF", 0, 0, 0, 0, 0, 0, 0, 0, "0x200000", "0x200000", 0}
    Property Node(instance in=w239, "gain"=$"tx 0.gain", "frequency shift"=$"tx 0.frequency shift", "phase"=$"tx 0.phase", "impairments"=$"tx 0.impairments", "input sample rate"=$"tx.input sample rate", "delay"=$"tx.delay") -> (instance out=w240)
    w241 = T25 {0, "0x1FFFF", "0x1FFFF", 0, 0, 0, 0, 0, 0, 0, 0, "0x200000", "0x200000", 0}
    Property Node(instance in=w241, "delay"=$"tx.delay", "input sample rate"=$"tx.input sample rate", "gain"=$"tx 1.gain", "frequency shift"=$"tx 1.frequency shift", "phase"=$"tx 1.phase", "impairments"=$"tx 1.impairments") -> (instance out=w242)
    Build Array(w240, w242) -> w243
    call "802.11 USRP Stream TX.gcdl"(tx.enable streams=w238, tx.reset=$"tx.reset", tx.rf channel=$"tx.rf channel", TX to RF FIFO reference=w224, tx.abort=$"tx.abort", DUC parameters=w243) -> (tx.state=w244, tx.samples processed=w245, tx.underflows=w246, tx.number of IQ data overflows=w247, tx.dsp reset done=w248)
    $"tx.state" <- w244
    $"rx.dsp reset done" <- w233
    $"tx.samples processed" <- w245
    $"rx.state" <- w235
    $"tx.underflows" <- w246
    $"rx.samples processed" <- w236
    $"tx.number of IQ data overflows" <- w247
    $"rx.number of overflows" <- w237
    $"tx.dsp reset done" <- w248
    $"DC average" <- w234
  }
  call "LEDs.gvi"()
  call "niUsrpRio Config v1 FPGA.lvlib__Process.gvi"(resources=w188)
